# Grasshopper definition ghowl_connect.gh (Grasshopper 1.0.7)
# plug-ins: gHowl

# ---- group: connection
get_local_ip_address = GhPythonScript()  # -> ip_address
# ---------- get_local_ip_address: Python ----------
__author__ = "ericsonm"
__version__ = "2023.01.30"

import socket
import time
import rhinoscriptsyntax as rs


sock = socket.socket(socket.AF_INET, socket.SOCK_STREAM)

local_hostname = socket.gethostname()
ip_address = socket.gethostbyname(local_hostname)
# ---------- end get_local_ip_address ----------
udp_receiver = UDPReceiver(Address=get_local_ip_address, Port="23456", Pattern="0")  # -> Info, Data
panel = Panel(udp_receiver.Data)
panel_2 = Panel(udp_receiver.Info)

# ---- group: hands
string_to_points = GhPythonScript(string=panel)  # -> points
# ---------- string_to_points: Python ----------
__author__ = "erics"
__version__ = "2023.02.08"

import rhinoscriptsyntax as rs

list = eval(string)

print(list)

points = rs.AddPoints(list)

print(points)
# ---------- end string_to_points ----------
xz_plane = XZPlane(Origin=Point(0, 0, 0))
mirror = Mirror(Geometry=string_to_points, Plane=xz_plane)  # -> Geometry, Transform
mirror_2 = Mirror(Geometry=mirror.Geometry, Plane=PlaneYZ(0, 0, 0))  # -> Geometry, Transform
point = Point(mirror_2.Geometry)
polyline = PolyLine(Vertices=point, Closed=False)
colour_hsv = ColourHSV(Alpha=1, Hue=Slider(0.66, range=0..1), Saturation=Slider(1, range=0..1), Value=Slider(1, range=0..1))
circle = Circle(Plane=point, Radius=Slider(20, range=0..100))
custom_preview = CustomPreview(Geometry=[polyline, circle], Material=colour_hsv)

# ---- group: mouse
string_to_number = GhPythonScript(string=udp_receiver.Data)  # -> numbers
# ---------- string_to_number: Python ----------
__author__ = "erics"
__version__ = "2023.02.08"

import rhinoscriptsyntax as rs

numbers = eval(string)
# ---------- end string_to_number ----------
list_item = ListItem(List=string_to_number, Index=0, Wrap=True)
list_item_2 = ListItem(List=string_to_number, Index="1", Wrap=True)
construct_point = ConstructPoint(XCoordinate=list_item, YCoordinate=list_item_2, ZCoordinate=0)
line = Line(StartPoint="0,0,0", EndPoint=construct_point)

# ----
custom_preview_2 = CustomPreview(Geometry=line, Material=colour_hsv)
