# Grasshopper definition koch_curve.gh (Grasshopper 1.0.7)

number_slider = Slider(99, range=0..100)
rectangle = Rectangle(Plane=PlaneXY(0, 0, 0), XSize=number_slider, YSize=number_slider, Radius=0)  # -> Rectangle, Length
explode = Explode(Curve=rectangle.Rectangle, Recursive=True)  # -> Segments, Vertices
koch_curve = GhPythonScript(curve=explode.Segments, max=Slider(5, range=0..5))  # -> k_curve
# ---------- koch_curve: Python ----------
__author__ = "erics"
__version__ = "2024.02.07"

import rhinoscriptsyntax as rs

def koch_curve(point_1, point_2):
    curve = rs.AddLine(point_1, point_2)
    center = rs.DivideCurve(curve, 2)[1]
    rot_line = rs.RotateObject(curve, center, 90, copy=True)
    end = rs.CurveEndPoint(rot_line)
    vector = rs.VectorCreate(center, end)
    unit_vec = rs.VectorUnitize(vector)
    rs.DeleteObject(rot_line)
    
    length = rs.CurveLength(curve)
    
    divide_3 = rs.DivideCurve(curve, 3, create_points = True)
    divide_2 = rs.DivideCurve(curve, 2, False)
    midpoint = rs.AddPoint(divide_2[1])
    distance = length/3
    move_vector = rs.VectorScale(unit_vec, distance)
    
    move_point = rs.MoveObject(midpoint, move_vector)
    divide_3.insert(2, move_point)
    pline = rs.AddPolyline(divide_3)
    points = rs.AddPoints(divide_3)
    return points
    

def recursive_curve(point_a, point_b, line_list, max):
    if max > 0:
        new_points = koch_curve(point_a, point_b)
        new_line = rs.AddPolyline(new_points)
        if max ==1:
            line_list.append(new_line)
        recursive_curve(new_points[0], new_points[1], line_list, max-1)
        recursive_curve(new_points[1], new_points[2], line_list, max-1)
        recursive_curve(new_points[2], new_points[3], line_list, max-1)
        recursive_curve(new_points[3], new_points[4], line_list, max-1)
    return line_list
    
    
point_1 = rs.CurveStartPoint(curve)
point_2 = rs.CurveEndPoint(curve)

line_list = []

k_curve = recursive_curve(point_1, point_2, line_list, max)
# ---------- end koch_curve ----------
