# Grasshopper definition viewport_tools.gh (Grasshopper 1.0.7)

center_box = CenterBox(Base=PlaneXY(0, 0, 0), X="1000", Y="1000", Z="1000")
create_viewport = GhPythonScript(create_viewport=Button(), width="800", height="800", view_name="Axo", projection="Top", display_mode="Rendered")  # inputs create_viewport: Boolean, width: Int32, height: Int32
# ---------- create_viewport: Python ----------
from ghpythonlib.componentbase import executingcomponent as component
import Grasshopper, GhPython
import System
import Rhino
import rhinoscriptsyntax as rs
import scriptcontext as sc

class MyComponent(component):
    
    def RunScript(self, create_viewport, width, height, view_name, projection, display_mode):
        """Provides a  component to create and control viewport
            Inputs:
                create_viewport:  Boolean to create viewport
                width: Width of viewport
                height:  Height of viewport
                view_name: Name of new viewport
                display_mode: Sets the display mode
                "Rendered", "Wireframe", "Ghosted", "Shaded", "X-Ray", "Arctic", "Technical", "Artistic", "Pen"
                zoom_extents:  Boolean to zoom window extents
                
                """

        
        __author__ = "erics"
        __version__ = "2022.11.10"
        
        
        def zoom_scale(percentage):
            """
            Zooms the active window by a value
            example:
            zoom_scale(.75)
            """
            command = "Zoom Factor" + " " + str(float(percentage))
            rs.Command(command)

        def set_display_mode(view_name, display_mode="Rendered"):
            """
            Sets the disaplay mode of a specific viewport
            view_name: name of the view
            display_mode: Sets the mode of of display.  If None == "Rendered".  
            "Rendered", "Wireframe", "Ghosted", "Shaded", "X-Ray", "Arctic", "Technical", "Artistic", "Pen"
            example:
            set_display_mode("Top", display_mode="Wireframe")
                """
            rs.EnableRedraw(True)
            viewport = sc.doc.Views.Find(view_name, False).ActiveViewport
            mode = Rhino.Display.DisplayModeDescription.FindByName("Rendered")
            viewport.DisplayMode = mode
            return viewport
        
        def create_parallel_view(view_name, size, projection, display="Rendered"):
            """Creates a new viewport in top, parallel view.
            view_name:  name of view to be added
            size:  Tuple of X and Y dimensions in pixels of the viewport to be created (x_size, y_size)
            display_mode: Sets the mode of of display.  If None == "Rendered".  
            "Rendered", "Wireframe", "Ghosted", "Shaded", "X-Ray", "Arctic", "Technical", "Artistic", "Pen"
            example:
            create_parallel_view("Axo", (800,800), display_mode="Rendered")
            """
            size_x, size_y = size
            method = "Rhino.Display.DefinedViewportProjection." + str(projection)
            view =  eval(method)
            dimensions = System.Drawing.Rectangle(20,20,size_x,size_y)
            sc.doc = Rhino.RhinoDoc.ActiveDoc
            sc.doc.Views.Add(view_name, view, dimensions,True)
            viewport = set_display_mode(view_name, display)
            return viewport
#main__________________________________________________________________________________________
        if create_viewport:
            if (width and height and display_mode and view_name and projection) != None: 
                viewport = create_parallel_view(view_name, (width, height), projection, display_mode)

        else:pass
# ---------- end create_viewport ----------
zoom_viewport = GhPythonScript(zoom_extents=Button(), view_name="Axo", zoom_factor=Slider(0.501, range=0..1))  # inputs zoom_extents: Boolean
# ---------- zoom_viewport: Python ----------
from ghpythonlib.componentbase import executingcomponent as component
import Grasshopper, GhPython
import System
import Rhino
import rhinoscriptsyntax as rs
import scriptcontext as sc

class MyComponent(component):
    
    def RunScript(self, zoom_extents, view_name, zoom_factor):
        """Sets Zoom scale for specific viewport
            Inputs:
                zoom_extents:  Boolean to zoom extents
                view_name:  Name of view to be scaled.
                zoom_factor:  Factor to scale the zoom"""
        
        
        __author__ = "erics"
        __version__ = "2022.11.10"

        if (zoom_extents and view_name):
            rs.ZoomExtents(view_name)
            if zoom_factor:
                factor = rs.ViewCameraLens() * float(zoom_factor)
                rs.ViewCameraLens(view_name, length=factor)
# ---------- end zoom_viewport ----------
